# Dynamo graph Class Chessdynamo.dyn (Dynamo 2.3.0.5885)

code_block = CodeBlock { "A"; }
code_block_2 = CodeBlock { "H"; }
range = Range(start=code_block, end=code_block_2)
code_block_3 = CodeBlock { 1; }
code_block_4 = CodeBlock { 8; }
range_2 = Range(start=code_block_3, end=code_block_4)

# group: кол-во клеток
буква_начальной_клетки = CodeBlock(w=range) { w[1]; }
code_block_5 = CodeBlock { 0; }
count = List.Count(list=range)
count_2 = List.Count(list=range_2)
code_block_6 = CodeBlock(a=count, b=count_2) { a*b; }
sequence = Sequence(start=code_block_5, amount=code_block_6)

цифра_начальной_клетки = CodeBlock(w=range_2) { w[1]; }
code_block_7 = CodeBlock { "A"; }
code_block_8 = CodeBlock { "H"; }
range_3 = Range(start=code_block_7, end=code_block_8)
буква_конечной_клетки = CodeBlock(w=range_3) { w[3]; }
code_block_9 = CodeBlock { 1; }
code_block_10 = CodeBlock { 8; }
range_4 = Range(start=code_block_9, end=code_block_10)
цифра_конечной_клетки = CodeBlock(w=range_4) { w[2]; }
python_script = Python(IN[0]=буква_начальной_клетки, IN[1]=цифра_начальной_клетки, IN[2]=буква_конечной_клетки, IN[3]=цифра_конечной_клетки)
# ---------- python_script.python (18 lines) ----------
# Загрузить стандартную библиотеку Python и библиотеку DesignScript
import sys
import clr
clr.AddReference('ProtoGeometry')
from Autodesk.DesignScript.Geometry import *

# Введенные в этом узле данные сохраняется в виде списка в переменных IN.
dataEnteringNode = IN

# Разместите код под этой строкой
a=IN[0] 
b=IN[1]
c=IN[2]
d=IN[3]
if a == c or b == d: 
   OUT ='YES'
else: OUT = 'NO'
# Назначьте вывод переменной OUT.
# ----------------------------------------
byCenterPointRadius = Circle.ByCenterPointRadius()
code_block_11 = CodeBlock { 4; }
regularPolygon = Polygon.RegularPolygon(circle=byCenterPointRadius, numberSides=code_block_11)
byCoordinates = Point.ByCoordinates()
python_script_2 = Python(IN[0]=range)
# ---------- python_script_2.python (15 lines) ----------
# Загрузить стандартную библиотеку Python и библиотеку DesignScript
import sys
import clr
clr.AddReference('ProtoGeometry')
from Autodesk.DesignScript.Geometry import *

# Введенные в этом узле данные сохраняется в виде списка в переменных IN.
dataEnteringNode = IN

# Разместите код под этой строкой
IN[0]
for IN[0][0],IN[0][7] 

# Назначьте вывод переменной OUT.
OUT = list(IN[0][0],IN[0][1],IN[0][2],IN[0][3],IN[0][4],IN[0][5],IN[0][6],IN[0][7])
# ----------------------------------------
python_script_3 = Python()  # unwired: IN[0]; starter script, not edited (OUT = 0)
