# Dynamo graph Geodome Python.dyn (Dynamo 2.3.0.5885)

categories = Categories("OST_StructuralFraming")
all_elements_of_category_in_view = ElementsOfCategoryInView(Category=categories)  # unwired: View
code_block = CodeBlock { 0; }
takeItems = List.TakeItems(list=all_elements_of_category_in_view, amount=code_block)
Z = Point.Z()  # unwired: point
dropItems = List.DropItems(list=all_elements_of_category_in_view, amount=code_block)
python_script = Python(IN[0]=dropItems)
# ---------- python_script.python (13 lines) ----------
# Загрузить стандартную библиотеку Python и библиотеку DesignScript
import sys
import clr
clr.AddReference('ProtoGeometry')
from Autodesk.DesignScript.Geometry import *

# Введенные в этом узле данные сохраняется в виде списка в переменных IN.
dataEnteringNode = IN

# Разместите код под этой строкой
a = IN[0]
# Назначьте вывод переменной OUT.
OUT = a[2:5]
# ----------------------------------------
python_script_2 = Python()  # unwired: IN[0]
# ---------- python_script_2.python (16 lines) ----------
# Загрузить стандартную библиотеку Python и библиотеку DesignScript
import sys
import clr
clr.AddReference('ProtoGeometry')
from Autodesk.DesignScript.Geometry import *

# Введенные в этом узле данные сохраняется в виде списка в переменных IN.
dataEnteringNode = IN

# Разместите код под этой строкой

point=IN[0][1]
a = point.deconstruct(point)

# Назначьте вывод переменной OUT.
OUT = a
# ----------------------------------------
geometry = Element.Geometry(element=dropItems)
flatten = List.Flatten(list=geometry)
code_block_2 = CodeBlock(w=flatten) { w[2]; }
code_block_3 = CodeBlock { 10; }
code_block_4 = CodeBlock { 10; }
code_block_5 = CodeBlock { 10; }
python_script_3 = Python(IN[0]=code_block_2, IN[1]=code_block_3, IN[2]=code_block_4, IN[3]=code_block_5)
# ---------- python_script_3.python (29 lines) ----------
# Загрузить стандартную библиотеку Python и библиотеку DesignScript
import sys
import clr
clr.AddReference('ProtoGeometry')
from Autodesk.DesignScript.Geometry import *



# Разместите код под этой строкой
solid = IN[0]
seed = IN[1]
xCount = IN[2]
yCount = IN[3]

solids = []

yDist = solid.BoundingBox.MaxPoint.Y-solid.BoundingBox.MinPoint.Y
xDist = solid.BoundingBox.MaxPoint.X-solid.BoundingBox.MinPoint.X

for i in xCount:
	for j in yCount:
		fromCoord = solid.ContextCoordinateSystem
		toCoord = fromCoord.Rotate(solid.ContextCoordinateSystem.Origin,Vector.ByCoordinates(0,0,1),(90*(i+j%val)))
		vec = Vector.ByCoordinates((xDist*i),(yDist*j),0)
		toCoord = toCoord.Translate(vec)
		solids.append(solid.Transform(fromCoord,toCoord))
	
# Назначьте вывод переменной OUT.
OUT = solids
# ----------------------------------------
