# Dynamo graph ex 1.dyn (Dynamo 2.3.0.5885)

code_block = CodeBlock { 1; }
code_block_2 = CodeBlock { 2; }
code_block_3 = CodeBlock { 3; }
python_script = Python(IN[0]=code_block, IN[1]=code_block_2, IN[2]=code_block_3)
# ---------- python_script.python (21 lines) ----------
# Загрузить стандартную библиотеку Python и библиотеку DesignScript
import sys
import clr
clr.AddReference('ProtoGeometry')
from Autodesk.DesignScript.Geometry import *

# Введенные в этом узле данные сохраняется в виде списка в переменных IN.
dataEnteringNode = IN

# Разместите код под этой строкой
a=IN[0]
b=IN[1]
c=IN[2]
if a == b == c:
    OUT = 3
elif a != b != c and a != c:
        OUT = 0
else: 
    a != b and b ==c or a != c and b == c or a == c and b!= c
    OUT = 2
# Назначьте вывод переменной OUT.
# ----------------------------------------
code_block_4 = CodeBlock {  }
