# Dynamo graph Home 123.dyn (Dynamo 2.3.0.5885)

code_block = CodeBlock { 0; }
code_block_2 = CodeBlock { 5; }
code_block_3 = CodeBlock { 5; }
sequence = Sequence(start=code_block, amount=code_block_2, step=code_block_3)
python_script = Python(IN[0]=sequence)
# ---------- python_script.python (15 lines) ----------
# Загрузить стандартную библиотеку Python и библиотеку DesignScript
import sys
import clr
clr.AddReference('ProtoGeometry')
from Autodesk.DesignScript.Geometry import *

# Введенные в этом узле данные сохраняется в виде списка в переменных IN.
dataEnteringNode = IN
IN[0]
IN[0].append(-999)
IN[0][0]=999
a= IN[0][::-1]
#print(IN[])
# Назначьте вывод переменной OUT.
OUT = a
# ----------------------------------------
code_block_4 = CodeBlock { 0..10..5; }
